# Dynamo graph SP_Estudo_Plano.dyn (Dynamo 2.3.0.5885)
# packages: Sistemas_Projetivos 1.0.0

rota_plano_de_projeção = DoubleSlider(90, range=0..90 step 10)  # "Rota Plano de Projeção Horizontal"
SP_Sistema_Diedrico = Custom[SP_Sistema_Diedrico]()  # package Sistemas_Projetivos; Cria os planos de projeção
abscissa = DoubleSlider(3.3, range=0..5 step 0.1)
afastamento = DoubleSlider(1.1, range=0..5 step 0.1)
cota = DoubleSlider(2.2, range=0..5 step 0.1)
SP_Locar_Ponto = Custom[SP_Locar_Ponto](Diedro=SP_Sistema_Diedrico, abscissa=abscissa, Afastamento=afastamento, Cota=cota)  # package Sistemas_Projetivos; Localiza um ponto em Sistema Diedrico
abscissa_2 = DoubleSlider(0.8, range=0..5 step 0.1)
afastamento_2 = DoubleSlider(1.8, range=0..5 step 0.1)
cota_2 = DoubleSlider(0.3, range=0..5 step 0.1)
SP_Locar_Ponto_2 = Custom[SP_Locar_Ponto](Diedro=SP_Sistema_Diedrico, abscissa=abscissa_2, Afastamento=afastamento_2, Cota=cota_2)
abscissa_3 = DoubleSlider(2.4, range=0..5 step 0.1)
afastamento_3 = DoubleSlider(1.8, range=0..5 step 0.1)
cota_3 = DoubleSlider(1.1, range=0..5 step 0.1)
SP_Locar_Ponto_3 = Custom[SP_Locar_Ponto](Diedro=SP_Sistema_Diedrico, abscissa=abscissa_3, Afastamento=afastamento_3, Cota=cota_3)
SP_Locar_Plano = Custom[SP_Locar_Plano](P1=SP_Locar_Ponto.Ponto, P2=SP_Locar_Ponto_2.Ponto, P3=SP_Locar_Ponto_3.Ponto, Diedro=SP_Locar_Ponto_3.Diedro)  # package Sistemas_Projetivos; Posiciona um plano a partir de 3 pontos
SP_Rotaciona_PPH_Plano = Custom[SP_Rotaciona_PPH_Plano](Angulo=rota_plano_de_projeção, Plano=SP_Locar_Plano.Plano, Diedro=SP_Locar_Plano.Diedro)  # Rotaciona o PPH do traçado
