# Dynamo custom node SP_Locar_Plano.dyf (Dynamo 2.3.0.5885)
# category: Sistemas_Projetivos
# Posiciona um plano a partir de 3 pontos

P1 = Input(P1: var[]..[])  # Se refere a um ponto utilizando as função SP_Locar_Ponto
P2 = Input(P2: var[]..[])  # Se refere a um ponto utilizando as função SP_Locar_Ponto
P3 = Input(P3: var[]..[])  # Se refere a um ponto utilizando as função SP_Locar_Ponto
code_block = CodeBlock(p1=P1, p2=P2, p3=P3)
# ---------- code_block.designscript (28 lines) ----------
Die = p1["Planos"];
Lte = p1["LTerra"];
pt1 = p1["Ponto"];
pt2 = p2["Ponto"];
pt3 = p3["Ponto"];
pr1 = p1["PontosProj"];
pr2 = p2["PontosProj"];
pr3 = p3["PontosProj"];
ra1 = p1["RaiosProj"];
ra2 = p2["RaiosProj"];
ra3 = p3["RaiosProj"];
ch1 = p1["Chamadas"];
ch2 = p2["Chamadas"];
ch3 = p3["Chamadas"];

Vz     = Vector.ZAxis();
Vy     = Vector.YAxis();
L3P    = [pt1 , pt2 , pt3];
Esfera = Sphere.ByCenterPointRadius ( L3P , 0.15 );
Polig  = PolyCurve.ByPoints         ( L3P , true );
Super  = Surface.ByPatch            ( Polig );
proHV  = PolyCurve.Project          ( Polig<1> , Die , [Vz, Vy]);
FigPla = Plane.ByThreePoints        ( pt1 , pt2 , pt3 );
Tracos = Plane.Intersect            ( Die , FigPla );
Infin  = Surface.BySweep            ( Tracos[0][1], Tracos[1][0]);
ke     = ["Diedro","LTerra","Pontos","Raios"        ,"Chamadas"     ,"PtProjetado"  ,"Esferas", "Contorno","Superficie","Projeções","Figura","Traços","PlanoInfinito"];
va     = [  Die   ,  Lte   , L3P    ,[ra1, ra2, ra3],[ch1, ch2, ch3],[pr1, pr2, pr3],Esfera   ,  Polig    , Super      , proHV     , FigPla , Tracos ,Infin];
Dic    = Dictionary.ByKeysValues(ke, va);
# ----------------------------------------
Resultado = Output(code_block.Dic)
