# Dynamo custom node SP_Sistema_Diedrico.dyf (Dynamo 2.3.0.5885)
# category: Sistemas_Projetivos
# Cria os planos de projeção

cria_sistema_de_planos = CodeBlock()
# ---------- cria_sistema_de_planos.designscript (10 lines) ----------
d=100;
x      = [ [0,d,d,0], [0, 0,-d,-d], [0, 0,-d,-d], [0,d, d, 0]];
y      = [ [0,0,d,d], [0, d, d, 0], [0, -d,-d,0], [0,0,-d,-d]];
z      = [ [0,0,0,0], [0, 0, 0, 0], [0,  0, 0,0], [0,0, 0, 0]];
PHp    = Point.ByCoordinates( x , y , z );
PVp    = Point.ByCoordinates( x , z , y );
PLp    = Point.ByCoordinates( z , x , y );
PlanH  = Surface.ByPerimeterPoints( PHp );
PlanV  = Surface.ByPerimeterPoints( PVp );
Diedro = [PlanH[0], PlanH[3], PlanV[0], PlanV[3]];
# ----------------------------------------
Planos_de_Projeção = Output(cria_sistema_de_planos.Diedro)
